# Dynamo graph dynamo 1 (4).dyn (Dynamo 3.2.2.5494)
# packages: Structural Design 2025.3.16

# group: Geometry of Poly Curve of Raft
elevation_mm = CodeBlock { -2000; }
byCoordinates = Point.ByCoordinates(z=elevation_mm)
length_of_raft = Python()  # CPython3; unwired: IN[0]
# ---------- length_of_raft.python (74 lines) ----------
# Load the Python Standard and Revit Libraries
import clr
import math

clr.AddReference("RevitAPI")
clr.AddReference("RevitServices")

from RevitServices.Persistence import DocumentManager
from Autodesk.Revit.DB import *

# Get the current Revit document
doc = DocumentManager.Instance.CurrentDBDocument

def get_top_face_area(floor):
    options = Options()
    options.ComputeReferences = True
    options.IncludeNonVisibleObjects = False

    geometry_element = floor.get_Geometry(options)

    for geo in geometry_element:
        if isinstance(geo, Solid) and geo.Faces.Size > 0:
            top_face = None
            max_z = -1e6

            for face in geo.Faces:
                try:
                    # Get UV midpoint and compute normal
                    bbox = face.GetBoundingBox()
                    u = (bbox.Min.U + bbox.Max.U) / 2
                    v = (bbox.Min.V + bbox.Max.V) / 2
                    uv = UV(u, v)
                    normal = face.ComputeNormal(uv)

                    # Check for upward facing face
                    if normal.Z > 0.99:
                        # Compute average Z height of triangulated mesh
                        mesh = face.Triangulate()
                        z_sum = 0
                        for i in range(mesh.NumTriangles):
                            tri = mesh.get_Triangle(i)
                            for j in range(3):
                                z_sum += tri.get_Vertex(j).Z
                        avg_z = z_sum / (mesh.NumTriangles * 3)

                        if avg_z > max_z:
                            max_z = avg_z
                            top_face = face
                except:
                    continue

            if top_face:
                return top_face.Area
            else:
                return None
    return None

# Collect all floor elements
floors = FilteredElementCollector(doc).OfCategory(BuiltInCategory.OST_Floors).WhereElementIsNotElementType().ToElements()

# Get the first floor element only
first_floor = floors[0] if len(floors) > 0 else None

if first_floor:
    area_ft2 = get_top_face_area(first_floor)  # Area in ft²
    if area_ft2:
        length_ft = math.sqrt(area_ft2)        # Convert area to length in ft
        length_mm = length_ft * 304.8           # Convert ft to mm
        rounded_mm = round(length_mm/1000)*1000     # Round to 2 decimal places
        OUT = rounded_mm
    else:
        OUT = "No top face area found"
else:
    OUT = "No floors found"
# ----------------------------------------
byCoordinates_2 = Point.ByCoordinates(y=length_of_raft, z=elevation_mm)
byStartPointEndPoint = Line.ByStartPointEndPoint(startPoint=byCoordinates, endPoint=byCoordinates_2)
byCoordinates_3 = Point.ByCoordinates(x=length_of_raft, y=length_of_raft, z=elevation_mm)
byStartPointEndPoint_2 = Line.ByStartPointEndPoint(startPoint=byCoordinates_2, endPoint=byCoordinates_3)
byCoordinates_4 = Point.ByCoordinates(x=length_of_raft, z=elevation_mm)
byStartPointEndPoint_3 = Line.ByStartPointEndPoint(startPoint=byCoordinates_3, endPoint=byCoordinates_4)
byStartPointEndPoint_4 = Line.ByStartPointEndPoint(startPoint=byCoordinates_4, endPoint=byCoordinates)
outline_curve = List.Create(item0=byStartPointEndPoint, item1=byStartPointEndPoint_2, item2=byStartPointEndPoint_3, item3=byStartPointEndPoint_4)
this_will_be_connected_to_floor = Watch(outline_curve)  # "This will be connected to Floor.ByOutlineTypeandLeveL"

# group: Providing Raft Thickness as Input parameter for Design
floor_types = FloorTypes("150mm Foundation Slab")
extracting_thickness_of_floor = StringInput("Default Thickness")
thickness_of_raft_mm = Element.GetParameterValueByName(element=floor_types, parameterName=extracting_thickness_of_floor)
watch = Watch(thickness_of_raft_mm)

# group: Host Element 3D Raft without Reinforcement > Level
elevation = CodeBlock { -2000; }
byElevation = Level.ByElevation(elevation=elevation)

# group: Host Element 3D Raft without Reinforcement
n3d_geometryof_raft = Floor.ByOutlineTypeAndLevel(outlineCurves=outline_curve, floorType=floor_types, level=byElevation)  # "3D Geometryof Raft"
category_type = StringInput("Structural")
boolean = BoolSelector(true)
host_element_raft = Element.SetParameterByName(element=n3d_geometryof_raft, parameterName=category_type, value=boolean)

# group: Make Rebars
layout_rule_2_fixed_spacing = CodeBlock { 2; }
flip = BoolSelector(false)
face_top_true_bottom_false = BoolSelector(true)
rebarbartype_check_from = RevitRebarBarType()  # "RebarBarType(check from Preferred Dia from Input Parameters)"; nothing selected
rebarShape = RevitRebarShape()  # nothing selected
boolean_2 = BoolSelector(false)

# group: Extracting No of Columns from Revit Model
# No of Columns is our first input parameter for prediction of foundation design and analysis
categories = Categories("OST_StructuralColumns")
all_elements_of_category = ElementsOfCategory(Category=categories)
no_of_columns = List.Count(list=all_elements_of_category)
watch_2 = Watch(no_of_columns)

# group: Extarcting Area of Slabs
# Area of slabs are used for determining area of rafts our input parameter for machine learning
extracting_area_of_slabs_m_2 = Python()  # CPython3; unwired: IN[0]
# ---------- extracting_area_of_slabs_m_2.python (74 lines) ----------
# Load the Python Standard and Revit Libraries
import clr
import math

clr.AddReference("RevitAPI")
clr.AddReference("RevitServices")

from RevitServices.Persistence import DocumentManager
from Autodesk.Revit.DB import *

# Get the current Revit document
doc = DocumentManager.Instance.CurrentDBDocument

def get_top_face_area(floor):
    options = Options()
    options.ComputeReferences = True
    options.IncludeNonVisibleObjects = False

    geometry_element = floor.get_Geometry(options)

    for geo in geometry_element:
        if isinstance(geo, Solid) and geo.Faces.Size > 0:
            top_face = None
            max_z = -1e6

            for face in geo.Faces:
                try:
                    # Get UV midpoint and compute normal
                    bbox = face.GetBoundingBox()
                    u = (bbox.Min.U + bbox.Max.U) / 2
                    v = (bbox.Min.V + bbox.Max.V) / 2
                    uv = UV(u, v)
                    normal = face.ComputeNormal(uv)

                    # Check for upward facing face
                    if normal.Z > 0.99:
                        # Compute average Z height of triangulated mesh
                        mesh = face.Triangulate()
                        z_sum = 0
                        for i in range(mesh.NumTriangles):
                            tri = mesh.get_Triangle(i)
                            for j in range(3):
                                z_sum += tri.get_Vertex(j).Z
                        avg_z = z_sum / (mesh.NumTriangles * 3)

                        if avg_z > max_z:
                            max_z = avg_z
                            top_face = face
                except:
                    continue

            if top_face:
                return top_face.Area
            else:
                return None
    return None

# Collect all floor elements
floors = FilteredElementCollector(doc).OfCategory(BuiltInCategory.OST_Floors).WhereElementIsNotElementType().ToElements()

# Get the first floor element only
first_floor = floors[0] if len(floors) > 0 else None

if first_floor:
    area_ft2 = get_top_face_area(first_floor)  # Area in ft²
    if area_ft2:
        length_ft = math.sqrt(area_ft2)        # Convert area to length in ft
        length_mm = length_ft * 304.8           # Convert ft to mm
        rounded_mm = round(length_mm, 2)        # Round to 2 decimal places
        OUT = rounded_mm
    else:
        OUT = "No top face area found"
else:
    OUT = "No floors found"
# ----------------------------------------
rounding_area_values = Math.Round(number=extracting_area_of_slabs_m_2)
areaof_raft_m_2 = List.MaximumItem(list=rounding_area_values)
watch_3 = Watch(areaof_raft_m_2)

# group: Extacing Colum Area(m^2)
extarcing_area_of_columns = Python()  # CPython3; unwired: IN[0]
# ---------- extarcing_area_of_columns.python (70 lines) ----------
# Load the Python Standard and DesignScript Libraries
import sys
# For Dynamo CPython3 or pyRevit
import clr
import sys

# Add Revit API references
clr.AddReference("RevitServices")
from RevitServices.Persistence import DocumentManager

clr.AddReference("RevitAPI")
from Autodesk.Revit.DB import *

doc = DocumentManager.Instance.CurrentDBDocument

def get_top_face_area(column):
    options = Options()
    options.ComputeReferences = True
    options.IncludeNonVisibleObjects = False

    geometry_element = column.get_Geometry(options)

    for geo in geometry_element:
        if isinstance(geo, Solid) and geo.Faces.Size > 0:
            top_face = None
            max_z = -1e6

            for face in geo.Faces:
                try:
                    # Get mid-UV and normal
                    bbox = face.GetBoundingBox()
                    u = (bbox.Min.U + bbox.Max.U) / 2
                    v = (bbox.Min.V + bbox.Max.V) / 2
                    uv = UV(u, v)
                    normal = face.ComputeNormal(uv)

                    # Check if normal points upward (Z axis)
                    if normal.Z > 0.99:
                        # Triangulate and get average Z
                        mesh = face.Triangulate()
                        z_sum = 0
                        for i in range(mesh.NumTriangles):
                            tri = mesh.get_Triangle(i)
                            for j in range(3):
                                z_sum += tri.get_Vertex(j).Z
                        avg_z = z_sum / (mesh.NumTriangles * 3)

                        if avg_z > max_z:
                            max_z = avg_z
                            top_face = face
                except:
                    continue

            if top_face:
                return top_face.Area
            else:
                return None
    return None

# Collect all structural columns
collector = FilteredElementCollector(doc).OfCategory(BuiltInCategory.OST_StructuralColumns).WhereElementIsNotElementType().ToElements()

areas = []

for column in collector:
    area = get_top_face_area(column)
    areas.append(area*0.092903)

# Output in Dynamo (use OUT)
OUT = areas
# ----------------------------------------
extracing_one_column_area = List.FirstItem(list=extarcing_area_of_columns)
decimal_places = CodeBlock { 3; }
round = Math.Round(number=extracing_one_column_area, digits=decimal_places)
watch_4 = Watch(round)

# group: Extracting Compressive Strength and Unit Weight of Concrete from Model
select_any_concrete_element_from = DSModelElementSelection()  # "Select Any Concrete Element from Model"; 1 picked in the model
compressive_strength_conc_fc_kpa = Python(IN[0]=select_any_concrete_element_from)  # CPython3
# ---------- compressive_strength_conc_fc_kpa.python (40 lines) ----------
import clr
clr.AddReference('RevitAPI')
from Autodesk.Revit.DB import *

clr.AddReference('RevitServices')
from RevitServices.Persistence import DocumentManager

# Inputs from Dynamo
element = UnwrapElement(IN[0])  # Selected Revit element
material_index = 0  # Index of the material to inspect if the element has multiple materials


# Get the active document
doc = DocumentManager.Instance.CurrentDBDocument

# Retrieve the material from the selected element
material = None

if isinstance(element, FamilyInstance) or isinstance(element, Wall):
    # Handle specific element types to extract the material
    material_ids = element.GetMaterialIds(False)
    if len(material_ids) > material_index:
        material = doc.GetElement(material_ids[material_index])

if material is not None:
    # Get Structural Asset Id
    structural_asset_id = material.StructuralAssetId
    if structural_asset_id != ElementId.InvalidElementId:
        # Get Structural Asset
        asset_element = doc.GetElement(structural_asset_id)
        structural_asset = asset_element.GetStructuralAsset()
        
        Compressive_Strength = structural_asset.ConcreteCompression
        
    else:
        CompressiveStrength = "No structural asset associated with the material"
else:
    CompressiveStrength = "Material not found in the selected element"
# converting N/ft.m Revit's Inbuilt Concrete Compression Unit and rounding to two decimal places
OUT = round(Compressive_Strength/304800,2)
# ----------------------------------------
density_in_kn_m_3 = Python(IN[0]=select_any_concrete_element_from)  # CPython3
# ---------- density_in_kn_m_3.python (45 lines) ----------
import clr
clr.AddReference('RevitAPI')
from Autodesk.Revit.DB import *

clr.AddReference('RevitServices')
from RevitServices.Persistence import DocumentManager

# Inputs from Dynamo
element = UnwrapElement(IN[0])  # Selected Revit element
material_index = 0  # Index of the material to inspect if the element has multiple materials

# Conversion Factor for Density
kgft3_to_kgm3 = 35.3147

# Get the active document
doc = DocumentManager.Instance.CurrentDBDocument

# Retrieve the material from the selected element
material = None

if isinstance(element, FamilyInstance) or isinstance(element, Wall):
    # Handle specific element types to extract the material
    material_ids = element.GetMaterialIds(False)
    if len(material_ids) > material_index:
        material = doc.GetElement(material_ids[material_index])

if material is not None:
    # Get Structural Asset Id
    structural_asset_id = material.StructuralAssetId
    if structural_asset_id != ElementId.InvalidElementId:
        # Get Structural Asset
        asset_element = doc.GetElement(structural_asset_id)
        structural_asset = asset_element.GetStructuralAsset()
        
        # Extract Density in kg/ft³
        density_kgft3 = structural_asset.Density
        
        # Convert to kg/m³
        density_kgm3 = density_kgft3 * kgft3_to_kgm3
    else:
        density_kgm3 = "No structural asset associated with the material"
else:
    density_kgm3 = "Material not found in the selected element"
#convert kg/m3 to KN/m3
OUT = round(density_kgm3*0.009817,2)
# ----------------------------------------
watch_5 = Watch(density_in_kn_m_3)
watch_6 = Watch(compressive_strength_conc_fc_kpa)

# group: Mannual Input Parameters
# Only input parameter Entered Manually
subgarde_modulus_kn_m_m2 = DoubleInput(18800)
max_axial_load_on_col_kn = DoubleInput(1726)
total_axial_load_kn = DoubleInput(52512)

# group: Input Preferred Bar Diameter(mm)
dia_bottom_x = DoubleInput(12.7)
dia_top_x = DoubleInput(12.7)
dia_bottom_y = DoubleInput(12.7)
dia_top_y = DoubleInput(12.7)

# group: Predicting Design of Raft with XGBoost with Testing Accuracy of 70%
headers = CodeBlock()
# ---------- headers.designscript (13 lines) ----------
["Number of Columns",
 "Area Of Raft (m^2)",
 "Compressive strength of Concrete Fc' (Mpa)",
 "Concrete Unit Weight (kN/m^3)",
 "Subgrade Modulus kN/m/m^2",
 "Column Area (m^2)",
 "Maximum Axial Load on Column in kN",
 "Total Axial load on Column (kN)",
 "Thickness of Raft (mm)",
 "Preffered Dia of Bars (mm) in Bottom direction X direction",
 "Preffered Dia of Bars (mm) X Top direction",
 "Preffered Dia of Bars (mm) Bottom Y direction",
 "Preffered Dia of Bars (mm) Top Y direction"];
# ----------------------------------------
values = List.Create(item0=no_of_columns, item1=areaof_raft_m_2, item2=round, item3=compressive_strength_conc_fc_kpa, item4=density_in_kn_m_3, item5=subgarde_modulus_kn_m_m2, item6=max_axial_load_on_col_kn, item7=total_axial_load_kn, item8=thickness_of_raft_mm, item9=dia_bottom_x, item10=dia_top_x, item11=dia_bottom_y, item12=dia_top_y)
list_create = List.Create(item0=headers, item1=values)
xg_boost_model_performing_output = Python(IN[0]=list_create)  # "XG BOOST Model Performing Output Predctions"; CPython3
# ---------- xg_boost_model_performing_output.python (151 lines) ----------
# Load the Python Standard and DesignScript Libraries
import sys
import clr
sys.path.append(r'C:\\Users\\Asad\\AppData\\Local\\Programs\\Python\\Python39\\lib\\site-packages')
clr.AddReference('ProtoGeometry')
from Autodesk.DesignScript.Geometry import *

# The inputs to this node will be stored as a list in the IN variables.
dataEnteringNode = IN

# Place your code below this line
# Load the Python Standard and DesignScript Libraries
import sys
import clr
clr.AddReference('ProtoGeometry')
from Autodesk.DesignScript.Geometry import *

# The inputs to this node will be stored as a list in the IN variables.
dataEnteringNode = IN

# Place your code below this line
import math
import pandas as pd
import numpy as np
from sklearn.preprocessing import StandardScaler, PolynomialFeatures
from sklearn.model_selection import train_test_split
from sklearn.metrics import r2_score
import xgboost as xgb
import warnings
warnings.filterwarnings('ignore')

# ------------------ Step 1: Load Excel Data ------------------
file_path = r"C:\Users\Asad\Downloads\Expanded Design data of raft.xlsx"
df = pd.read_excel(file_path)

# ------------------ Step 2: Define Input & Output Features ------------------
X = df[[ 
    'Number of  Columns', 'Area Of Raft (m^2)', "Compressive strength of Concrete Fc' (Mpa)",
    'Concrete Unit Weight (kN/m^3)', 'Subgrade Modulus kN/m/m^2',
    'Column Area (m^2)', 'Maximum Axial Load on Column in kN',
    'Total Axial load on Column (kN)', 'Thickness of Raft (mm)',
    'Preffered Dia of Bars (mm) in Bottom direction X direction',
    'Preffered Dia of Bars (mm) X Top direction',
    'Preffered Dia of Bars (mm) Bottom Y direction',
    'Preffered Dia of Bars (mm) Top Y direction'
]]

y = df[[ 
    'Bottom As (mm^2/m) X strip',
    'Top As (mm^2/m) X strip',
    'Bottom As (mm^2/m) Y strip',
    'Top As (mm^2/m) Y strip'
]]

# ------------------ Step 3: Split and Scale ------------------
X_train, X_test, y_train, y_test = train_test_split(X, y, test_size=0.2, random_state=42)
scaler = StandardScaler()
X_train_scaled = scaler.fit_transform(X_train)
X_test_scaled = scaler.transform(X_test)

# Polynomial Features
poly = PolynomialFeatures(degree=2, include_bias=False)
X_train_poly = poly.fit_transform(X_train_scaled)
X_test_poly = poly.transform(X_test_scaled)

# ------------------ Step 4: Train XGBoost Models ------------------
xgb_params = {
    'max_depth': 4,
    'min_child_weight': 5,
    'subsample': 0.8,
    'colsample_bytree': 0.8,
    'reg_alpha': 0.1,
    'reg_lambda': 1.0,
    'learning_rate': 0.05,
    'n_estimators': 1000,
    'random_state': 42
}

xgb_models = []
for i in range(y.shape[1]):
    model = xgb.XGBRegressor(**xgb_params, early_stopping_rounds=50)
    model.fit(X_train_poly, y_train.iloc[:, i], eval_set=[(X_test_poly, y_test.iloc[:, i])], verbose=False)
    xgb_models.append(model)

# ------------------ Step 5: Spacing and Count Calculations ------------------
def calculate_bar_spacing_and_count(area_required, bar_diameter, strip_width=1000):
    area_required = max(area_required, 0)
    bar_area = (math.pi * bar_diameter ** 2) / 4

    if bar_area <= 0:
        return 200, 1

    num_bars_per_meter = area_required / bar_area
    if num_bars_per_meter > 0:
        spacing = strip_width / num_bars_per_meter
        spacing = round(spacing / 5) * 5
        num_bars = math.ceil(strip_width / spacing) + 1
    else:
        spacing = strip_width
        num_bars = 1

    min_spacing = max(3 * bar_diameter, 75)
    max_spacing = 200
    spacing = max(min_spacing, min(spacing, max_spacing))
    num_bars = math.ceil(strip_width / spacing) + 1

    return spacing, num_bars

def predict_with_calculations(y_pred_areas, X_original):
    all_predictions = np.zeros((y_pred_areas.shape[0], 12))
    for i in range(y_pred_areas.shape[0]):
        # Extract bar diameters
        bottom_x_dia = X_original[i][9]
        top_x_dia = X_original[i][10]
        bottom_y_dia = X_original[i][11]
        top_y_dia = X_original[i][12]

        current_areas = y_pred_areas[i]
        if len(current_areas.shape) > 1:
            current_areas = current_areas.flatten()
        areas = [max(area, 0) for area in current_areas]
        diameters = [bottom_x_dia, top_x_dia, bottom_y_dia, top_y_dia]

        for j, (area, dia) in enumerate(zip(areas, diameters)):
            spacing, num_bars = calculate_bar_spacing_and_count(area, dia)
            all_predictions[i, j * 3:(j + 1) * 3] = [area, spacing, num_bars]

    return all_predictions.tolist()

# ------------------ Step 6: Dynamo IN Prediction ------------------
dataEnteringNode = IN
input_data = IN[0]  # Expecting [[labels], [values]]
if not input_data or len(input_data) < 2:
    OUT = "Invalid input structure. Expecting [[labels], [values]]"
else:
    try:
        # Convert to numpy
        input_values = np.array([input_data[1]])  # 1 row
        input_scaled = scaler.transform(input_values)
        input_poly = poly.transform(input_scaled)

        # Predict areas
        area_preds = np.array([model.predict(input_poly) for model in xgb_models]).T  # shape: (1, 4)

        # Combine with original X input row to get bar diameters
        final_output = predict_with_calculations(area_preds, [input_data[1]])

        OUT = final_output  # List of [As, spacing, bar_count] × 4 strips

    except Exception as e:
        OUT = "Error during prediction: " + str(e)
# ----------------------------------------
output_predictions_area_of_steel = Watch(xg_boost_model_performing_output)  # "Output Predictions (Area of Steel, Spacing,No of Bars) in 4 Directions"
input_parameters = Watch(values)

# group: Spacing Of Reinforcment Bars of Raft Foundation
output_predictions_of_raft = List.FirstItem(list=xg_boost_model_performing_output)  # "Output Predictions of Raft Design"
code_block = CodeBlock { 4; }
top_x = List.GetItemAtIndex(list=output_predictions_of_raft, index=code_block)
code_block_2 = CodeBlock { 7; }
bottom_y = List.GetItemAtIndex(list=output_predictions_of_raft, index=code_block_2)
code_block_3 = CodeBlock { 10; }
top_y = List.GetItemAtIndex(list=output_predictions_of_raft, index=code_block_3)
code_block_4 = CodeBlock { 1; }
bottom_x = List.GetItemAtIndex(list=output_predictions_of_raft, index=code_block_4)

# group: Create Rebars(Top Reinforcement ) Y
concerete_cover_for_top = CodeBlock { 50; }  # "Concerete Cover for Top Reinforcement(mm)"
rebar_length_top = length_of_raft - concerete_cover_for_top
layout_rule_2_fixed_spacing_2 = CodeBlock { 2; }
flip_2 = BoolSelector(false)
face_top_true_bottom_false_2 = BoolSelector(true)
rebarbartype_check_from_2 = RevitRebarBarType()  # "RebarBarType(check from Preferred Dia from Input Parameters)"; nothing selected
rebarShape_2 = RevitRebarShape()  # nothing selected
boolean_3 = BoolSelector(false)

# group: Top X Rebar
# HostElement	The Revit element (e.g., Floor, Slab, Wall) where the rebar will be hosted
# curvesPath	A Curve or list of Curves (typically Lines) that defines the path of the rebar
# layoutRule	Rebar layout type:
# | flip | Boolean:
# true = flip bar direction
# false = default orientation |
# | face | Integer representing face (usually 0 = top, 1 = bottom), depending on host |
# | primaryBarType | Revit Rebar Bar Type element for the main bar |
# | primaryBarShape | Rebar shape (e.g., straight, U-shaped, L-shaped), a Revit element |
# | primarySpacing | Spacing between primary bars (in feet) |
# | primaryNumberLines | Number of lines of bars (e.g., 2 layers side-by-side) |
# | primaryBarLength | Length override for the primary bars (optional, in feet) |
createByCurveAndShapeCode = StructuralDesign.Rebar.PathReinforcement.PathReinforcement.CreateByCurveAndShapeCode(hostElement=host_element_raft, curvesPath=byStartPointEndPoint, layoutRule=layout_rule_2_fixed_spacing, flip=flip, face=face_top_true_bottom_false, primaryBarType=rebarbartype_check_from, primaryBarShape=rebarShape, primarySpacing=top_x, primaryBarLength=rebar_length_top)

# group: Top Y
# HostElement	The Revit element (e.g., Floor, Slab, Wall) where the rebar will be hosted
# curvesPath	A Curve or list of Curves (typically Lines) that defines the path of the rebar
# layoutRule	Rebar layout type:
# | flip | Boolean:
# true = flip bar direction
# false = default orientation |
# | face | Integer representing face (usually 0 = top, 1 = bottom), depending on host |
# | primaryBarType | Revit Rebar Bar Type element for the main bar |
# | primaryBarShape | Rebar shape (e.g., straight, U-shaped, L-shaped), a Revit element |
# | primarySpacing | Spacing between primary bars (in feet) |
# | primaryNumberLines | Number of lines of bars (e.g., 2 layers side-by-side) |
# | primaryBarLength | Length override for the primary bars (optional, in feet) |
createByCurveAndShapeCode_2 = StructuralDesign.Rebar.PathReinforcement.PathReinforcement.CreateByCurveAndShapeCode(hostElement=host_element_raft, curvesPath=byStartPointEndPoint_2, layoutRule=layout_rule_2_fixed_spacing_2, flip=flip_2, face=face_top_true_bottom_false_2, primaryBarType=rebarbartype_check_from_2, primaryBarShape=rebarShape_2, primarySpacing=top_y, primaryBarLength=rebar_length_top)

# group: Create Rebars(Bottom X Reinforcement )
layout_rule_2_fixed_spacing_3 = CodeBlock { 2; }
flip_3 = BoolSelector(false)
face_top_true_bottom_false_3 = BoolSelector(true)
rebarbartype_check_from_3 = RevitRebarBarType()  # "RebarBarType(check from Preferred Dia from Input Parameters)"; nothing selected
rebarShape_3 = RevitRebarShape()  # nothing selected
length_of_raft_2 = Python()  # CPython3; unwired: IN[0]; same code as length_of_raft
concrete_cover_for_bottom = CodeBlock { 75; }  # "Concrete Cover for Bottom Reinforment(mm)"
rebar_length_bottom = length_of_raft_2 - concrete_cover_for_bottom

# group: Bottom X
# HostElement	The Revit element (e.g., Floor, Slab, Wall) where the rebar will be hosted
# curvesPath	A Curve or list of Curves (typically Lines) that defines the path of the rebar
# layoutRule	Rebar layout type:
# | flip | Boolean:
# true = flip bar direction
# false = default orientation |
# | face | Integer representing face (usually 0 = top, 1 = bottom), depending on host |
# | primaryBarType | Revit Rebar Bar Type element for the main bar |
# | primaryBarShape | Rebar shape (e.g., straight, U-shaped, L-shaped), a Revit element |
# | primarySpacing | Spacing between primary bars (in feet) |
# | primaryNumberLines | Number of lines of bars (e.g., 2 layers side-by-side) |
# | primaryBarLength | Length override for the primary bars (optional, in feet) |
createByCurveAndShapeCode_3 = StructuralDesign.Rebar.PathReinforcement.PathReinforcement.CreateByCurveAndShapeCode(hostElement=host_element_raft, curvesPath=byStartPointEndPoint_3, layoutRule=layout_rule_2_fixed_spacing_3, flip=flip_3, face=face_top_true_bottom_false_3, primaryBarType=rebarbartype_check_from_3, primaryBarShape=rebarShape_3, primarySpacing=bottom_x, primaryBarLength=rebar_length_bottom)

# group: Create Rebars(Bottom Reinforcement ) Y
host_element_raft_2 = Element.SetParameterByName(element=n3d_geometryof_raft, parameterName=category_type, value=boolean)
layout_rule_2_fixed_spacing_4 = CodeBlock { 2; }
flip_4 = BoolSelector(false)
face_top_true_bottom_false_4 = BoolSelector(true)
rebarbartype_check_from_4 = RevitRebarBarType()  # "RebarBarType(check from Preferred Dia from Input Parameters)"; nothing selected
rebarShape_4 = RevitRebarShape()  # nothing selected
top_y_2 = List.GetItemAtIndex(list=output_predictions_of_raft, index=code_block_3)
length_of_raft_3 = Python()  # CPython3; unwired: IN[0]; same code as length_of_raft
concrete_cover_for_bottom_2 = CodeBlock { 75; }  # "Concrete Cover for Bottom Reinforment(mm)"
rebar_length_bottom_2 = length_of_raft_3 - concrete_cover_for_bottom_2

# group: Bottom Y
# HostElement	The Revit element (e.g., Floor, Slab, Wall) where the rebar will be hosted
# curvesPath	A Curve or list of Curves (typically Lines) that defines the path of the rebar
# layoutRule	Rebar layout type:
# | flip | Boolean:
# true = flip bar direction
# false = default orientation |
# | face | Integer representing face (usually 0 = top, 1 = bottom), depending on host |
# | primaryBarType | Revit Rebar Bar Type element for the main bar |
# | primaryBarShape | Rebar shape (e.g., straight, U-shaped, L-shaped), a Revit element |
# | primarySpacing | Spacing between primary bars (in feet) |
# | primaryNumberLines | Number of lines of bars (e.g., 2 layers side-by-side) |
# | primaryBarLength | Length override for the primary bars (optional, in feet) |
createByCurveAndShapeCode_4 = StructuralDesign.Rebar.PathReinforcement.PathReinforcement.CreateByCurveAndShapeCode(hostElement=host_element_raft_2, curvesPath=byStartPointEndPoint_4, layoutRule=layout_rule_2_fixed_spacing_4, flip=flip_4, face=face_top_true_bottom_false_4, primaryBarType=rebarbartype_check_from_4, primaryBarShape=rebarShape_4, primarySpacing=top_y_2, primaryBarLength=rebar_length_bottom_2)

# group: Analysis of Raft Foundation by Predicting Settlement, Punching Shear and Bearing Pressure
extracting_all_parameters_for = CodeBlock { 9; }  # "Extracting all Parameters for Analysis less Bar Dia"
input_parameters_for_analysis = List.TakeItems(list=values, amount=extracting_all_parameters_for)
python_script = Python(IN[0]=input_parameters_for_analysis)  # CPython3
# ---------- python_script.python (99 lines) ----------
# Load the Python Standard and DesignScript Libraries
import sys
import clr
sys.path.append(r'C:\\Users\\Asad\\AppData\\Local\\Programs\\Python\\Python39\\lib\\site-packages')
clr.AddReference('ProtoGeometry')
from Autodesk.DesignScript.Geometry import *

# The inputs to this node will be stored as a list in the IN variables.
dataEnteringNode = IN

# Place your code below this line
import sys
import clr
clr.AddReference('ProtoGeometry')
from Autodesk.DesignScript.Geometry import *

# Make sure ML libraries are accessible (you already used sys.path.append in Dynamo startup script)
import pandas as pd
import numpy as np
from sklearn.ensemble import ExtraTreesRegressor
from sklearn.multioutput import MultiOutputRegressor
from sklearn.model_selection import train_test_split
from sklearn.preprocessing import StandardScaler
from sklearn.metrics import r2_score, mean_squared_error, mean_absolute_error

import warnings
warnings.filterwarnings('ignore')

# ========== Step 1: Read Excel Data ==========
file_path = r"C:\Users\Asad\Downloads\Expanded Analysis of Rafts (1).xlsx"
df = pd.read_excel(file_path)
df.columns = df.columns.str.strip()  # Clean column names
# === Step 2: Select and Engineer Features ===
df['Load_per_Column'] = df['Total Axial load on Column (kN)'] / df['Number of  Columns']
df['Raft_Load_Ratio'] = df['Total Axial load on Column (kN)'] / df['Area Of Raft (m^2)']
df['Column_Density'] = df['Number of  Columns'] / df['Area Of Raft (m^2)']
df['Strength_to_Load_Ratio'] = df["Compressive strength of Concrete Fc' (Mpa)"] / df['Maximum Axial Load on Column in kN']

features = [
    'Column Area (m^2)', 'Area Of Raft (m^2)', 'Total Axial load on Column (kN)',
    "Compressive strength of Concrete Fc' (Mpa)", 'Concrete Unit Weight (kN/m^3)',
    'Subgrade Modulus kN/m/m^2', 'Thickness of Raft (mm)',
    'Load_per_Column', 'Raft_Load_Ratio', 'Column_Density', 'Strength_to_Load_Ratio'
]
X = df[features]
y = df[['Settlement (mm)', 'Punching Shear Value', 'Bearing Pressure (kPa)']]

# === Step 3: Train Model ===
X_train, X_test, y_train, y_test = train_test_split(X, y, test_size=0.2, random_state=42)
scaler = StandardScaler()
X_train_scaled = scaler.fit_transform(X_train)
X_test_scaled = scaler.transform(X_test)
model = MultiOutputRegressor(ExtraTreesRegressor(n_estimators=100, max_depth=10, random_state=42))
model.fit(X_train_scaled, y_train)

# === Step 4: Predict from Dynamo Input (IN[0]) ===
try:
    inputs = IN[0]  # List of 9 values from List.Create

    # Unpack inputs
    num_cols = float(inputs[0])
    raft_area = float(inputs[1])
    col_area = float(inputs[2])
    fc = float(inputs[3])
    unit_weight = float(inputs[4])
    subgrade = float(inputs[5])
    max_axial = float(inputs[6])
    total_axial = float(inputs[7])
    thickness = float(inputs[8])

    # Compute engineered features
    load_per_col = total_axial / num_cols
    raft_load_ratio = total_axial / raft_area
    col_density = num_cols / raft_area
    strength_to_load = fc / max_axial

    input_vector = [
        col_area, raft_area, total_axial, fc, unit_weight,
        subgrade, thickness, load_per_col, raft_load_ratio,
        col_density, strength_to_load
    ]

    input_scaled = scaler.transform([input_vector])
    prediction = model.predict(input_scaled)[0]

    labels = ['Settlement (mm)', 'Punching Shear', 'Bearing Pressure (kPa)']
    prediction_dict = dict(zip(labels, map(float, prediction)))

    # === Step 5: Add R² Metrics for Reference ===
    test_pred = model.predict(X_test_scaled)
    r2_scores = [r2_score(y_test.iloc[:, i], test_pred[:, i]) for i in range(3)]
    metrics = dict(zip(labels, [round(r2, 4) for r2 in r2_scores]))

    OUT = [prediction_dict, metrics]

except Exception as e:
    OUT = [f"Prediction Error: {str(e)}", {}]

  
# ----------------------------------------
watch_7 = Watch(python_script)

# group: Reviewing Analsysis to Check if the Design is Feasible
code_block_5 = CodeBlock { 0; }
extracting_predicted_values_of = List.GetItemAtIndex(list=python_script, index=code_block_5)  # "Extracting Predicted Values of Analysis"
allowable_bearing_capacity = DoubleSlider(25, range=0..100 step 0.1)
index = CodeBlock { 5; }
modulus_of_subgrade = List.GetItemAtIndex(list=input_parameters_for_analysis, index=index)
code_complaince_checks_to = Python(IN[0]=extracting_predicted_values_of, IN[1]=allowable_bearing_capacity, IN[2]=modulus_of_subgrade)  # "Code Complaince Checks to determine Design Feasibility"; CPython3
# ---------- code_complaince_checks_to.python (41 lines) ----------
# Load the Python Standard and DesignScript Libraries
import sys
import clr
clr.AddReference('ProtoGeometry')
from Autodesk.DesignScript.Geometry import *

# --- Inputs ---
prediction_dict = IN[0]  # This should be the dictionary: {"Settlement (mm)": ..., ...}
allowable_settlement = IN[1]  # e.g. 50
subgrade_modulus = IN[2]      # e.g. 25000

# --- Extract predictions from dictionary ---
try:
    settlement = prediction_dict["Settlement (mm)"]
    punching = prediction_dict["Punching Shear"]
    bearing_pressure = prediction_dict["Bearing Pressure (kPa)"]

    # --- Bearing capacity formula ---
    bearing_capacity = (subgrade_modulus * settlement) / 2  # in kPa

    # --- Design checks ---
    errors = []

    if settlement > allowable_settlement:
        errors.append("❌ Settlement exceeded: {:.2f} mm > {:.2f} mm".format(settlement, allowable_settlement))

    if punching > 1.0:
        errors.append("❌ Punching shear exceeded: {:.2f} > 1.0".format(punching))

    if bearing_pressure > bearing_capacity:
        errors.append("❌ Bearing pressure exceeded: {:.2f} kPa > Capacity {:.2f} kPa".format(
            bearing_pressure, bearing_capacity))

    # --- Output result ---
    if errors:
        OUT = ["❌ Design Failed", errors]
    else:
        OUT = ["✅ Design Passed", prediction_dict]

except Exception as e:
    OUT = ["❌ Error processing input:", str(e)]
# ----------------------------------------
result = Watch(code_complaince_checks_to)
